# Grasshopper definition builder.gh (Grasshopper 1.0.8)

crv = Curve(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)
geo = Geometry([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])
geo_2 = Geometry([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])
geo_3 = Geometry(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)
geo_4 = Geometry(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)
road = Python3Script(crvs=crv, width=Slider(4, range=0..10))  # -> road_data; inputs crvs: list of Curve, width: Double
# ---------- road: Python ----------
road_data = []
for crv in crvs:
    road_data.append((crv, width))
# ---------- end road ----------
road_2 = Python3Script(crvs=geo_3, width=Slider(9, range=0..10))  # -> road_data; inputs crvs: list of Curve, width: Double; same code as road
road_3 = Python3Script(crvs=geo, width=Slider(5, range=0..10))  # -> road_data; inputs crvs: list of Curve, width: Double; same code as road
road_4 = Python3Script(crvs=geo_4, width=Slider(10, range=0..10))  # -> road_data; inputs crvs: list of Curve, width: Double; same code as road
road_5 = Python3Script(crvs=geo_2, width=Slider(6, range=0..10))  # -> road_data; inputs crvs: list of Curve, width: Double; same code as road
py3 = Python3Script()  # -> out, a, b, c, d
# ---------- py3: Python ----------
import scriptcontext as sc

a,b,c,d= sc.sticky["Junction"]


print (a)
print (b)
print ()
# ---------- end py3 ----------
merge_road_data = Python3Script(road_data_list=[road, road_3, road_5, road_2, road_4])  # -> result; inputs road_data_list: list
# ---------- merge_road_data: Python ----------
result = []
for road_data in road_data_list:
    result.append(road_data)
# ---------- end merge_road_data ----------

# ---- group: RoadNetwork & Block Builder
roadnetwork_block = Python3Script(script=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, road_data=merge_road_data)  # -> out, road_network, blocks; inputs road_data: list; unedited script template

# ----
py3_2 = Python3Script()  # -> block_infos
# ---------- py3_2: Python ----------
import units
from units import BlockInfo

example_landuse_data = {
    "type_A": {
        "block_ids": [1, 2, 3],
        "gfa": 5.0,  # 용적률
        "bcr": 0.45,  # 건폐율
        "landuses": ["residential", "retail"],
        "pedestrian_width": 3.0,
    },
    "type_B": {
        "block_ids": [4, 5],
        "gfa": 7.5,
        "bcr": 0.55,
        "landuses": ["office", "retail"],
        "pedestrian_width": 4.0,
    },
    "type_C": {
        "block_ids": [6, 7],
        "gfa": 3.5,
        "bcr": 0.35,
        "landuses": ["park", "community"],
        "pedestrian_width": 2.0,
    },
}

# 딕셔너리 데이터를 사용하여 BlockInfo 객체 생성
block_info_A = BlockInfo(**example_landuse_data["type_A"])
block_info_B = BlockInfo(**example_landuse_data["type_B"])
block_info_C = BlockInfo(**example_landuse_data["type_C"])

block_infos = [block_info_A, block_info_B, block_info_C]
# ---------- end py3_2 ----------
panel = Panel(roadnetwork_block.out)

# ---- group: LandUse Setting
landuse = Python3Script(script=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, blocks=roadnetwork_block.blocks, block_infos=py3_2)  # -> blocks, road_network; inputs blocks: list, block_infos: list; unedited script template

landuse_2 = Python3Script(script=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, blocks=landuse.blocks, road_network=landuse.road_network)  # -> blocks, road_network; inputs blocks: list; unedited script template
